# Grasshopper definition 131108_DynamicRelaxation_pn.gh (Grasshopper 0.9.61)
# plug-ins: Python Interpreter

second_moment_of_area = Slider(0.25, range=0..1)
second_moment_of_area_2 = Slider(0.25, range=0..1)
# MATERIALS
second_moment_of_area_3 = Slider(0.25, range=0..1)
e_value = Slider(1796.982, range=0..2500)
e_value_2 = Slider(2500, range=0..2500)
e_value_3 = Slider(1834.457, range=0..2500)
s_value = Slider(0.25, range=0..1)
s_value_2 = Slider(0.25, range=0..1)
s_value_3 = Slider(0.25, range=0..1)
path_mapper = PathMapper(["MATERIAL ONE", e_value_3, second_moment_of_area_3, s_value_3], source="{0}", target="{0}")
path_mapper_2 = PathMapper(["MATERIAL THREE", e_value_2, second_moment_of_area_2, s_value_2], source="{0}", target="{2}")
path_mapper_3 = PathMapper(["MATERIAL TWO", e_value, second_moment_of_area, s_value], source="{0}", target="{1}")

# ----
# Bending Materials
# Elastics Materials
# Cable Materials
panel = Panel("MATERIAL THREE")
# ELEMENTS
panel_2 = Panel("MATERIAL ONE")
crv = Curve(<curve referenced from the Rhino model>)
crv_2 = Curve([<curve referenced from the Rhino model> x4])
crv_3 = Curve([<curve referenced from the Rhino model> x3])
crv_4 = Curve([<curve referenced from the Rhino model> x4])
path_mapper_4 = PathMapper([crv, panel], source="{0}", target="{0}")
path_mapper_5 = PathMapper([crv_2, "MATERIAL FOUR"], source="{0}", target="{0}")
path_mapper_6 = PathMapper([crv_4, panel_2], source="{0}", target="{0}")
path_mapper_7 = PathMapper([crv_3, "MATERIAL TWO"], source="{0}", target="{1}")

merge = Merge(Data1=path_mapper_6, Data2=path_mapper_7)
merge_2 = Merge(Data1=path_mapper, Data2=path_mapper_3, Data3=path_mapper_2)
run = BooleanToggle(True)
reset = BooleanToggle(False)
step_size = Slider(8000, range=1..50000)
timer = Timer(TimerInterval=2)
# Also, if you right click an input parameter you can tell python what type of variable it is using the 'type hint' in the bottom
fixed_points = Point([Point(0, 15, 0), Point(-5, 15, 0), Point(-10, 15, 0), Point(-15, 15, 0), Point(-15, -15, 0), Point(-10, -15, 0), Point(-5, -15, 0), Point(0, -15, 0)])

# ----
# LOADS
pt = Point([<point referenced from the Rhino model> x4])
newtons = Slider(2500, range=0..250000)
pt_2 = Point([<point referenced from the Rhino model> x4])
newtons_2 = Slider(2500, range=0..250000)
vec = VectorXYZ(XComponent=Slider(0, range=0..1), YComponent=Slider(0, range=0..1), ZComponent=Slider(1, range=0..1))  # -> Vector, Length
vec_2 = VectorXYZ(XComponent=Slider(0, range=0..1), YComponent=Slider(1, range=0..1), ZComponent=Slider(0, range=0..1))  # -> Vector, Length
line = LineSDL(Start=pt, Direction=vec.Vector, Length=newtons)
line_2 = LineSDL(Start=pt_2, Direction=vec_2.Vector, Length=newtons_2)
rev = Reverse(Vector=vec.Vector)
rev_2 = Reverse(Vector=vec_2.Vector)
vdis = VectorDisplay(Anchor=pt, Vector=rev)
vdis_2 = VectorDisplay(Anchor=pt_2, Vector=rev_2)

vec_3 = VectorXYZ(XComponent=newtons, YComponent=0, ZComponent=0)  # -> Vector, Length
vec_4 = VectorXYZ(XComponent=newtons_2, YComponent=0, ZComponent=0)  # -> Vector, Length

path_mapper_8 = PathMapper([pt_2, vec_2.Vector, vec_4.Vector], source="{0}", target="{1}")
path_mapper_9 = PathMapper([pt, vec.Vector, vec_3.Vector], source="{0}", target="{0}")

merge_3 = Merge(Data1=path_mapper_9, Data2=path_mapper_8)
dynamic_relaxation_engine = PythonScript(
    bendings=merge,
    elastics=path_mapper_4,
    cables=path_mapper_5,
    loads=merge_3,
    fixedPoints=fixed_points,
    materials=merge_2,
    run=run,
    reset=reset,
    step=step_size)  # -> out, bendingsOUT, elasticsOUT, cablesOUT, loadsOUT, fixedPointsOUT, particles; inputs bendings: tree, elastics: tree, cables: tree, loads: list, fixedPoints: list of Point3d, materials: tree
# ---------- dynamic_relaxation_engine: Python ----------
import Rhino # this is all the Rhino common classes and stuff (documentation here: http://4.rhino3d.com/5/rhinocommon/)
import rhinoscriptsyntax as rs

import sys

#import DynamicRelaxationFaster as DynamicRelaxation
import DynamicRelaxation


"""This component takes as input different sets of lines to define a dynamic relaxation (DR) process to find their equilibrium position.

This is the first example of a (hopefully) running code.

There are of course several things that need to be done:
    
    TODO allow for different materials in same kind of elements (e.g. tow different bending stiffnesses) maybe as pairs sets [ [list,material],[otherlist]other material]]
    TODO have a way to define generic materials (young modulus E + section area A + second moment of inertia I)(as a python class?)
    TODO add load elements as triple [position, direction, value]

The code is heavily inspired by the TraerPhysics library for Processing by J. Traer and several amendments/improvements 
made by Guillaume Labelle and Julien Nembrini in TraerAnar as a link to the ANAR+ library (http://anar.ch) 

This code is copyrighted by Julien Nembrini and distributed open source in the sense of the Gnu GPL v3.0. 

"""

#@@@@@@@@@@@@@@@@@@@@@@@@@@@@@@@
#@@@@@@@@@@@@@@@@@@@@@@@@@@@@@@@
#@@@@@@@@@@@@@@@@@@@@@@@@@@@@@@@
#@@@@@@@@@@@@@@@@@@@@@@@@@@@@@@@

def makePtFromRhino(pt):
    return DynamicRelaxation.Point3D(pt.X,pt.Y,pt.Z)
    
def makePtsFromRhino(pts):
    a = []
    for pt in pts:
        a.append(makePtFromRhino(pt))
    return a
    
#@@@@@@@@@@@@@@@@@@@@@@@@@@@@@@@
#@@@@@@@@@@@@@@@@@@@@@@@@@@@@@@@
#@@@@@@@@@@@@@@@@@@@@@@@@@@@@@@@
#@@@@@@@@@@@@@@@@@@@@@@@@@@@@@@@

print 'A prototype for dynamic relaxation in Rhino/GH/python. (c) Julien Nembrini'

#print sys.path

#@@@@@@@@@@@@@@@@@@@@@@@@@@@@@@@
#@@@@@@@@@@@@@@@@@@@@@@@@@@@@@@@
#@@@@@@@@@@@@@@@@@@@@@@@@@@@@@@@
#@@@@@@@@@@@@@@@@@@@@@@@@@@@@@@@

# Initialisation

if reset :
    
    # create particle system no drag no gravity
    ps = DynamicRelaxation.ParticleSystem()
    #ps = ParticleSystem(Vector3D(0,0,1), 0.5)
    #ps.setIntegrator(DynamicRelaxation.ParticleSystem.EULER)
    
    print ps
    
    #### materials
    matName = []
    matEval = []
    matMom = []
    matS = []
    for i in range(materials.BranchCount):
        matName.append (materials.Branch(i)[0])
        matEval.append (materials.Branch(i)[1])
        matMom.append (materials.Branch(i)[2])
        matS.append (materials.Branch(i)[3])
        
    #### bending elements
    allBendings = [] 
    allBendingsParts = [] 

    for i in range(bendings.BranchCount):
        matSpec = bendings.Branch(i)[len(bendings.Branch(i))-1]
        for j in range(len(bendings.Branch(i))-1):
            pts = rs.PolylineVertices(bendings.Branch(i)[j])
            if pts: 
                #create the bending elements (registered automagically in ps)
                parts,bends = DynamicRelaxation.makeBendingsFromList(ps, makePtsFromRhino(pts),matEval[matName.index(matSpec)],matMom[matName.index(matSpec)],matS[matName.index(matSpec)])
                
                # keep a copy for display of the particles making a bending line
                allBendingsParts.append(parts)
                allBendings.append(bends)
    
    print 'bendings :' + str(len(ps.bendings))
    
    #### elastic elements
    #DynamicRelaxation.makeElasticsFromList(ps, makePtsFromRhino(pts))
    
    allElastics = [] 
    allElasticsParts = [] 
    
    for i in range(elastics.BranchCount):
        matSpec = elastics.Branch(i)[len(elastics.Branch(i))-1]
        for j in range(len(elastics.Branch(i))-1):
            pts = rs.PolylineVertices(elastics.Branch(i)[j])
            if pts: 
                #create the bending elements (registered automagically in ps)
                parts,elas = DynamicRelaxation.makeElasticsFromList(ps, makePtsFromRhino(pts))#QUESTION - MATERIAL PROPERTIES?
                # keep a copy for display of the particles making a bending line
                allElasticsParts.append(parts)
                allElastics.append(elas)
    
    print 'elastics :' + str(len(ps.elastics))
    
    #### cables elements
    #DynamicRelaxation.makeElasticsFromList(ps, makePtsFromRhino(pts))
    
    allCables = [] 
    allCablesParts = [] 
    
    for i in range(cables.BranchCount):
        matSpec = cables.Branch(i)[len(cables.Branch(i))-1]
        for j in range(len(cables.Branch(i))-1):
            pts = rs.PolylineVertices(cables.Branch(i)[j])
            if pts: 
                #create the bending elements (registered automagically in ps)
                parts,cabls = DynamicRelaxation.makeCablesFromList(ps, makePtsFromRhino(pts))#QUESTION - MATERIAL PROPERTIES?
                # keep a copy for display of the particles making a bending line
                allCablesParts.append(parts)
                allCables.append(cabls)
                
    print 'cables :' + str(len(ps.cables))
    
    # TODO make a construction loop for all these kind of elements
    #DynamicRelaxation.makeSpringsFromList(ps, makePtsFromRhino(pts),1,0)

    #DynamicRelaxation.makeCablesFromList(ps, makePtsFromRhino(pts))
    #DynamicRelaxation.makeAttractionsFromList(ps, makePtsFromRhino(pts),100)
    #DynamicRelaxation.makeLoadsFromList(ps, makePtsFromRhino(pts[3:5]))
    
    # fix particles at the end
    for pt in fixedPoints:
        ps.findParticleEqualToPoint(makePtFromRhino(pt)).makeFixed()
    
    print 'particles :' + str(len(ps.particles))
    
    stepCount = 0

#@@@@@@@@@@@@@@@@@@@@@@@@@@@@@@@
#@@@@@@@@@@@@@@@@@@@@@@@@@@@@@@@
#@@@@@@@@@@@@@@@@@@@@@@@@@@@@@@@
#@@@@@@@@@@@@@@@@@@@@@@@@@@@@@@@

# Dynamic Relaxation step

if run:
    for i in range(10):
        ps.step(step)
    ps.stepRelax(step)
    #stepCount += 1
    #print stepCount


#@@@@@@@@@@@@@@@@@@@@@@@@@@@@@@@
#@@@@@@@@@@@@@@@@@@@@@@@@@@@@@@@
#@@@@@@@@@@@@@@@@@@@@@@@@@@@@@@@
#@@@@@@@@@@@@@@@@@@@@@@@@@@@@@@@

# Display functions


#center = Rhino.Geometry.Point3d((supportPtsIn[0].X + supportPtsIn[1].X) * .5, (supportPtsIn[0].Y + supportPtsIn[1].Y) * .5, (supportPtsIn[0].Z + supportPtsIn[1].Z) * .5)

bendingsOUT = []
elasticsOUT = []
cablesOUT = []

for bend in allBendingsParts:
    parts = []
    for p in bend :
        part = Rhino.Geometry.Point3d(p.position.x(), p.position.y(), p.position.z())
        parts.append(part)
        bendingsOUT.append(Rhino.Geometry.PolylineCurve(parts))
        
for elas in allElasticsParts:
    parts = []
    for p in elas :
        part = Rhino.Geometry.Point3d(p.position.x(), p.position.y(), p.position.z())
        parts.append(part)
        elasticsOUT.append(Rhino.Geometry.PolylineCurve(parts))
        
for cabl in allCablesParts:
    parts = []
    for p in cabl :
        part = Rhino.Geometry.Point3d(p.position.x(), p.position.y(), p.position.z())
        parts.append(part)
        cablesOUT.append(Rhino.Geometry.PolylineCurve(parts))
        
particles = []
for p in ps.particles:
    part = Rhino.Geometry.Point3d(p.position.x(), p.position.y(), p.position.z())
    particles.append(part)
    

#curveOut = Rhino.Geometry.PolylineCurve(pts)
# ---------- end dynamic_relaxation_engine ----------
pt_3 = Point(dynamic_relaxation_engine.particles)  # disabled
crv_5 = Curve(dynamic_relaxation_engine.bendingsOUT)  # disabled
panel_3 = Panel(dynamic_relaxation_engine.out)
