# Grasshopper definition DynamicRelaxation.gh (Grasshopper 0.9.61)
# plug-ins: Python Interpreter

# This is some geometry from Rhino
crv = Curve(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)
pt = Point([Point(0, 0, 0), Point(15, 0, 0)])
second_moment_of_area = Slider(0.25, range=0..1)
second_moment_of_area_2 = Slider(0.25, range=0..1)
second_moment_of_area_3 = Slider(0.25, range=0..1)
# The names you give the input/output parameters, are accessible within the script (you do not need to declare anything)
subdiv = Slider(7, range=0..24)
e_value = Slider(0.25, range=0..1)
e_value_2 = Slider(0.25, range=0..1)
e_value_3 = Slider(0.25, range=0..1)
etc = Slider(0.25, range=0..1)
etc_2 = Slider(0.25, range=0..1)
etc_3 = Slider(0.25, range=0..1)
step_size = Slider(4174.165, range=1..5000)
reset = BooleanToggle(True)
timer = Timer(TimerInterval=2, Target=dynamic_relaxation_engine)
# Also, if you right click an input parameter you can tell python what type of variable it is using the 'type hint' in the bottom
run = BooleanToggle(False)
panel = Panel(["MATERIAL TWO", e_value, second_moment_of_area, etc])
panel_2 = Panel(["MATERIAL THREE", e_value_2, second_moment_of_area_2, etc_2])
panel_3 = Panel(["MATERIAL ONE", e_value_3, second_moment_of_area_3, etc_3])
dynamic_relaxation_engine = PythonScript(curveIn=crv, supportPtsIn=pt, subDiv=subdiv, run=run, reset=reset, step=step_size)  # -> out, curveOut, bendedCrv, curvePoints; inputs curveIn: Curve, supportPtsIn: list of Point3d, subDiv: Int32
# ---------- dynamic_relaxation_engine: Python ----------
import Rhino # this is all the Rhino common classes and stuff (documentation here: http://4.rhino3d.com/5/rhinocommon/)
#import rhinoscriptsyntax as rs

import sys

import DynamicRelaxation


"""This component takes as input different sets of lines to define a dynamic relaxation (DR) process to find their equilibrium position.

This is the first example of a (hopefully) running code.

There are of course several things that need to be done:
    
    TODO allow for different materials in same kind of elements (e.g. tow different bending stiffnesses) maybe as pairs sets [ [list,material],[otherlist]other material]]
    TODO have a way to define generic materials (young modulus E + section area A + second moment of inertia I)(as a python class?)
    TODO add load elements as triple [position, direction, value]

The code is heavily inspired by the TraerPhysics library for Processing by J. Traer and several amendments/improvements 
made by Guillaume Labelle and Julien Nembrini in TraerAnar as a link to the ANAR+ library (http://anar.ch) 

This code is copyrighted by Julien Nembrini and distributed open source in the sense of the Gnu GPL v3.0. 

"""

#@@@@@@@@@@@@@@@@@@@@@@@@@@@@@@@
#@@@@@@@@@@@@@@@@@@@@@@@@@@@@@@@
#@@@@@@@@@@@@@@@@@@@@@@@@@@@@@@@
#@@@@@@@@@@@@@@@@@@@@@@@@@@@@@@@

def makePtFromRhino(pt):
    return DynamicRelaxation.Point3D(pt.X,pt.Y,pt.Z)
    
def makePtsFromRhino(pts):
    a = []
    for pt in pts:
        a.append(makePtFromRhino(pt))
    return a
    
#@@@@@@@@@@@@@@@@@@@@@@@@@@@@@@@
#@@@@@@@@@@@@@@@@@@@@@@@@@@@@@@@
#@@@@@@@@@@@@@@@@@@@@@@@@@@@@@@@
#@@@@@@@@@@@@@@@@@@@@@@@@@@@@@@@

print 'A prototype for dynamic relaxation in Rhino/GH/python. (c) Julien Nembrini'

#print sys.path

#@@@@@@@@@@@@@@@@@@@@@@@@@@@@@@@
#@@@@@@@@@@@@@@@@@@@@@@@@@@@@@@@
#@@@@@@@@@@@@@@@@@@@@@@@@@@@@@@@
#@@@@@@@@@@@@@@@@@@@@@@@@@@@@@@@

# Initialisation

if reset :
    
    pts = []
    for i in range(0,subDiv+1):
        crvPt = Rhino.Geometry.Curve.PointAt(curveIn, curveIn.Domain[1]/subDiv * i)
        pts.append(crvPt)
    #print pts
    
    # create particle system no drag no gravity
    ps = DynamicRelaxation.ParticleSystem()
    #ps = ParticleSystem(Vector3D(0,0,1), 0.5)
    #ps.setIntegrator(ParticleSystem.EULER)
    print ps
    
    #create the bending elements (registered automagically in ps)
    #DynamicRelaxation.makeBendingsFromList(ps, makePtsFromRhino(pts),28000e06,7e-09,2.01062e-04)
    
    DynamicRelaxation.makeSpringsFromList(ps, makePtsFromRhino(pts),1,0)
    #DynamicRelaxation.makeElasticsFromList(ps, makePtsFromRhino(pts))
    #DynamicRelaxation.makeCablesFromList(ps, makePtsFromRhino(pts))
    DynamicRelaxation.makeAttractionsFromList(ps, makePtsFromRhino(pts),100)
    
    
    DynamicRelaxation.makeLoadsFromList(ps, makePtsFromRhino(pts[3:5]))
    
    
    print len(ps.particles)
    print len(ps.loads)
    
    
    
    # TODO this should be changed by providing a list of fixed points
    # fix particles at the ends
    ps.particles[0].makeFixed()
    ps.particles[-1].makeFixed()
    
    
    
    
    

#@@@@@@@@@@@@@@@@@@@@@@@@@@@@@@@
#@@@@@@@@@@@@@@@@@@@@@@@@@@@@@@@
#@@@@@@@@@@@@@@@@@@@@@@@@@@@@@@@
#@@@@@@@@@@@@@@@@@@@@@@@@@@@@@@@

# Dynamic Relaxation step

if run:
    for i in range(10):
        #ps.step(step)
        ps.stepRelax(step)


#@@@@@@@@@@@@@@@@@@@@@@@@@@@@@@@
#@@@@@@@@@@@@@@@@@@@@@@@@@@@@@@@
#@@@@@@@@@@@@@@@@@@@@@@@@@@@@@@@
#@@@@@@@@@@@@@@@@@@@@@@@@@@@@@@@

# Display functions


#center = Rhino.Geometry.Point3d((supportPtsIn[0].X + supportPtsIn[1].X) * .5, (supportPtsIn[0].Y + supportPtsIn[1].Y) * .5, (supportPtsIn[0].Z + supportPtsIn[1].Z) * .5)
parts = []

for p in ps.particles:
    part = Rhino.Geometry.Point3d(p.position.x(), p.position.y(), p.position.z())
    parts.append(part)
   

bendedCrv = Rhino.Geometry.PolylineCurve(parts)
  
curvePoints = parts
curveOut = Rhino.Geometry.PolylineCurve(pts)
# ---------- end dynamic_relaxation_engine ----------
path_mapper = PathMapper(panel_3, source="{0}", target="{0}")
path_mapper_2 = PathMapper(panel_2, source="{0}", target="{2}")
path_mapper_3 = PathMapper(panel, source="{0}", target="{1}")
pt_2 = Point(dynamic_relaxation_engine.curvePoints)
crv_2 = Curve(dynamic_relaxation_engine.curveOut)
crv_3 = Curve(dynamic_relaxation_engine.bendedCrv)
panel_4 = Panel(dynamic_relaxation_engine.out)
panel_5 = Panel([path_mapper, path_mapper_3, path_mapper_2])
